# Grasshopper definition PCG_CIty.gh (Grasshopper 1.0.8)
# plug-ins: RhinoCodePluginGH

surface = Surface(<surface referenced from the Rhino model>)  # disabled
area = Area(Geometry=surface)  # -> Area, Centroid; disabled
number_slider = Slider(50000, range=0..1000000)  # disabled
scale = Scale(Geometry=surface, Center=Point(0, 0, 0), Factor=0.5)  # -> Geometry, Transform; disabled
integer_division = IntegerDivision(A=area.Area, B=number_slider)  # disabled
number_slider_2 = Slider(10, range=0..10)  # disabled
number_slider_3 = Slider(0, range=0..100)  # disabled
populate_2d = Populate2D(Region=scale.Geometry, Count=100, Seed=1)  # disabled
list_length = ListLength(List=populate_2d)  # disabled
populate_2d_2 = Populate2D(Region=surface, Count=integer_division, Seed=1)  # disabled
construct_domain = ConstructDomain(DomainStart=number_slider_3, DomainEnd=list_length)  # disabled
integer_division_2 = IntegerDivision(A=integer_division, B=number_slider_2)  # disabled
random = Random(Range=construct_domain, Number=integer_division_2, Seed=2)  # disabled
number_slider_4 = Slider(10, range=0..10)  # disabled
voronoi = Voronoi(Points=populate_2d_2, Boundary=surface, BruteForceOverride=False)  # disabled
list_item = ListItem(List=populate_2d, Index=random, Wrap=True)  # disabled
surface_2 = Surface(<surface referenced from the Rhino model>)
negative = Negative(Value=number_slider_4)  # disabled
number_slider_5 = Slider(30, range=0..100)  # disabled
offset_curve = OffsetCurve(Curve=voronoi, Distance=negative, Corners=1)  # -> flatten(Curve); disabled
negative_2 = Negative(Value=number_slider_5)  # disabled
boundary_surfaces = BoundarySurfaces(Edges=offset_curve)  # disabled
area_2 = Area(Geometry=surface_2)  # -> Area, Centroid
curve = Curve(surface_2)
offset_curve_2 = OffsetCurve(Curve=offset_curve, Distance=negative_2, Corners=1)  # disabled
area_3 = Area(Geometry=boundary_surfaces)  # -> Area, Centroid; disabled
number_slider_6 = Slider(6301, range=0..10000)  # disabled
square = Square(Value=Slider(300, range=0..1000))
square_2 = Square(Value=Slider(300, range=0..1000))
entwine = Entwine(Branch00=offset_curve, Branch01=offset_curve_2, FlattenInputs=True)  # disabled
multiplication = Multiplication(A=square, B=Slider(2, range=0..100))
integer_division_3 = IntegerDivision(A=area_3.Area, B=number_slider_6)  # disabled
multiplication_2 = Multiplication(A=square_2, B=Slider(10, range=0..100))
number_slider_7 = Slider(20, range=0..110)  # disabled
scale_2 = Scale(Geometry=surface_2, Center=area_2.Centroid, Factor=Slider(0.8, range=0..1))  # -> Geometry, Transform
integer_division_4 = IntegerDivision(A=area_2.Area, B=multiplication)
flip_matrix = FlipMatrix(Data=entwine)  # disabled
scale_3 = Scale(Geometry=surface_2, Center=area_2.Centroid, Factor=Slider(0.5, range=0..1))  # -> Geometry, Transform
integer_division_5 = IntegerDivision(A=area_2.Area, B=multiplication_2)
mesh_surface = MeshSurface(Surface=boundary_surfaces, UCount=integer_division_3, VCount=integer_division_3, Overhang=True, Equalize=False)  # disabled
divide_curve = DivideCurve(Curve=offset_curve, Count=number_slider_7, Kinks=False)  # -> Points, Tangents, Parameters; disabled
divide_curve_2 = DivideCurve(Curve=curve, Count=10, Kinks=False)  # -> Points, Tangents, Parameters
face_boundaries = FaceBoundaries(Mesh=mesh_surface)  # disabled
populate_2d_3 = Populate2D(Region=scale_2.Geometry, Count=integer_division_4, Seed=1)
boundary_surfaces_2 = BoundarySurfaces(Edges=flip_matrix)  # disabled
populate_2d_4 = Populate2D(Region=scale_3.Geometry, Count=integer_division_5, Seed=1)
pull_point = PullPoint(Point=divide_curve.Points, Geometry=offset_curve_2, ClosestOnly=True)  # -> ClosestPoint, Distance; disabled
area_4 = Area(Geometry=face_boundaries)  # -> Area, Centroid; disabled
number_slider_8 = Slider(30, range=0..100)
pull_point_2 = PullPoint(Point=area_4.Centroid, Geometry=offset_curve, ClosestOnly=True)  # -> ClosestPoint, Distance; disabled
merge = Merge(Data1=populate_2d_4, Data2=populate_2d_3)  # -> flatten(Result)
line = Line(StartPoint=divide_curve.Points, EndPoint=pull_point.ClosestPoint)  # disabled
point_in_curve = PointInCurve(Point=pull_point_2.ClosestPoint, Curve=face_boundaries)  # -> Relationship, Point; disabled
python_3_script = Python3Script(
    S=surface_2,
    Pts=merge,
    U=number_slider_8,
    V=number_slider_8,
    A=Slider(0.1, range=0..1),
    B=Slider(0.5, range=0..1),
    K=Slider(0.8, range=0..10),
    CenterList=populate_2d_4)  # -> out, PtsOut, Major, Minor; inputs S: Surface, Pts: list of Point3d, U: Int32, V: Int32, CenterList: list of Point3d
# ---------- python_3_script: Python ----------
import Rhino.Geometry as rg
import math
import random

# -----------------------------
# 工具函数
# -----------------------------
def rotate90(v):
    # 2D旋转90°（Z轴上）
    return rg.Vector3d(-v.Y, v.X, 0)

def safe_unit(v):
    if v.Length == 0:
        return rg.Vector3d(0,0,0)
    v.Unitize()
    return v

# -----------------------------
# 1. 生成采样点（在Surface上）
# -----------------------------
pts = []
u_domain = S.Domain(0)
v_domain = S.Domain(1)

for i in range(U):
    for j in range(V):
        u = u_domain.T0 + (u_domain.T1 - u_domain.T0) * i / (U - 1)
        v = v_domain.T0 + (v_domain.T1 - v_domain.T0) * j / (V - 1)
        p = S.PointAt(u, v)
        pts.append(p)

# -----------------------------
# 2. 计算Tensor Field
# -----------------------------
major_list = []
minor_list = []

# ---------------------------------------------------------
# 核心逻辑：偏转采样
# ---------------------------------------------------------
for p in pts:
    # 1. 计算全局背景流 (Base Flow) - 向心力
    v_composite = rg.Vector3d(1, 1, 0)
    # for cnt in CenterList:
    #     vec_to_cnt = rg.Vector3d(cnt.X - p.X, cnt.Y - p.Y, cnt.Z - p.Z)
    #     d_cnt = vec_to_cnt.Length + 1e-6
    #     # 背景权重：可以设得比较远
    #     w_base = 1.0 / math.pow(d_cnt, 1.2) # 指数小一点，让远处的点也能被吸过去
    #     vec_to_cnt.Unitize()
    #     v_composite += vec_to_cnt * w_base
    
    # if v_composite.Length > 1e-6:
    #     v_composite.Unitize()
    
    # 基础前进向量
    V_final = v_composite *0.5

    # 2. 局部干扰点进行“路径偏转” (Slingshot / Deflection)
    # 建议在 GH 里设置：Radius (影响半径), Strength (偏转强度)
    InfluenceRadius = 400.0  # 超过这个距离就不受干扰了
    Strength = 5          # 偏转力度

    for c in Pts:
        # 计算点到干扰点的位移
        to_c = rg.Vector3d(c.X - p.X, c.Y - p.Y, c.Z - p.Z)
        dist = to_c.Length + 1e-6
        
        if dist < InfluenceRadius:
            # 计算干扰权重 (0.0 到 1.0)
            # 使用余弦平滑切换或线性平滑，防止突变
            weight = (1.0 - dist / InfluenceRadius) ** 2 
            
            # 找到当前背景流的法线 (Perpendicular)
            # 我们需要知道点是在干扰点的左边还是右边
            dir_to_c = safe_unit(to_c)
            # 计算叉积来决定偏转方向 (在 XY 平面)
            cross = rg.Vector3d.CrossProduct(V_final, dir_to_c)
            
            # 根据点的位置，产生一个“绕行”的向量
            # perp 会垂直于当前的前进方向
            side_vec = rotate90(V_final)
            if cross.Z > 0: # 如果干扰点在流向的左侧，向右偏转
                side_vec *= -1
            
            # 混合偏转：V_final 依然占主导，side_vec 负责带偏方向
            # A 控制向心(收缩)，B 控制绕行(弹弓)
            # 这里我们加大 B 的权重，减小 A，就能出弹弓感
            deflection = (A * dir_to_c + B * side_vec) * weight * Strength
            V_final += deflection

    # 3. 规范化最终结果
    major = V_final
    if major.Length > 1e-6:
        major.Unitize()
        
    minor = rotate90(major)
    
    major_list.append(major)
    minor_list.append(minor)

# -----------------------------
# 输出
# -----------------------------
PtsOut = pts
Major = major_list
Minor = minor_list
# ---------- end python_3_script ----------
surface_split = SurfaceSplit(Surface=boundary_surfaces_2, Curves=line)  # disabled
curve_2 = Curve(surface_2)
area_5 = Area(Geometry=surface_split)  # -> Area, Centroid; disabled
curve_3 = Curve(surface_2)
number_slider_9 = Slider(0.8, range=0..1)  # disabled
dispatch = Dispatch(List=face_boundaries, DispatchPattern=point_in_curve.Relationship)  # -> ListA, ListB; disabled
reverse = Reverse(Vector=python_3_script.Major)
vector_display = VectorDisplay(Anchor=python_3_script.PtsOut, Vector=python_3_script.Major)
curve_4 = Curve(dispatch.ListB)  # disabled
area_6 = Area(Geometry=curve_4)  # -> Area, Centroid; disabled
python_3_script_2 = Python3Script(
    Pts=python_3_script.PtsOut,
    Vecs=python_3_script.Major,
    Seeds=divide_curve_2.Points,
    Step=Slider(10, range=0..10),
    MaxSteps=Slider(200, range=0..1000),
    SnapDist=Slider(3, range=0..10),
    Boundary=curve_2)  # -> out, roads; inputs Pts: list of Point3d, Vecs: list of Vector3d, Seeds: list of Point3d, Step: Int32, MaxSteps: Int32, SnapDist: Int32, Boundary: Curve
# ---------- python_3_script_2: Python ----------
import Rhino.Geometry as rg

# -----------------------------
# 最近点采样 field
# -----------------------------
def sample_field(p, pts, vecs):
    # --- 参数调整 ---
    k = 3 # 考虑最近的3个采样点进行混合。值越大越丝滑，但计算量稍大。
    
    # 存储距离和对应的向量
    distances_and_vecs = []
    for i in range(len(pts)):
        d = p.DistanceTo(pts[i])
        if d < 1e-7: return vecs[i] # 如果刚好重合，直接返回该向量
        distances_and_vecs.append((d, vecs[i]))
    
    # 按距离从小到大排序，取前 k 个点
    distances_and_vecs.sort(key=lambda x: x[0])
    top_k = distances_and_vecs[:k]
    
    # 权重求和计算
    sum_v = rg.Vector3d(0, 0, 0)
    total_weight = 0
    
    for dist, v_raw in top_k:
        # 权重与距离的平方成反比 (IDW算法)
        # 这样离得越近的点，对方向的影响力越大
        weight = 1.0 / (dist * dist) 
        sum_v += v_raw * weight
        total_weight += weight
    
    # 归一化最终向量
    if total_weight > 0:
        sum_v /= total_weight
        
    if sum_v.Length > 1e-6:
        sum_v.Unitize()
    
    return sum_v
# -----------------------------
# 是否接近已有路
# -----------------------------
def is_near_roads(p, roads, dist_thresh):
    for crv in roads:
        t = 0.0
        rc, t = crv.ClosestPoint(p)
        if rc:
            cp = crv.PointAt(t)
            if p.DistanceTo(cp) < dist_thresh:
                return True
    return False

# -----------------------------
# 主生成逻辑
# -----------------------------
roads = []

for seed in Seeds:
    
    pts_chain = [seed]
    current = seed
    
    for i in range(MaxSteps):
        
        # 1. 采样方向
        v = sample_field(current, Pts, Vecs)
        
        if v.Length == 0:
            break
        
        # 2. 前进一步
        next_p = current + v * Step
        
        # 3. 边界检测
        if Boundary:
            if not Boundary.Contains(next_p):
                break
        
        # 4. 吸附已有路（避免重叠）
        if is_near_roads(next_p, roads, SnapDist):
            pts_chain.append(next_p)
            break
        
        pts_chain.append(next_p)
        current = next_p
    
    # 至少2点才生成路
    if len(pts_chain) > 2:
        pl = rg.Polyline(pts_chain)
        roads.append(pl.ToNurbsCurve())


# -----------------------------
# 输出
# -----------------------------
Roads = roads
# ---------- end python_3_script_2 ----------
scale_4 = Scale(Geometry=surface_split, Center=area_5.Centroid, Factor=number_slider_9)  # -> Geometry, Transform; disabled
number_slider_10 = Slider(0.2, range=0..1)  # disabled
python_3_script_3 = Python3Script(
    Pts=python_3_script.PtsOut,
    Vecs=python_3_script.Minor,
    Seeds=divide_curve_2.Points,
    Step=Slider(10, range=0..10),
    MaxSteps=Slider(200, range=0..1000),
    SnapDist=Slider(3, range=0..10),
    Boundary=curve_3)  # -> out, roads; inputs Pts: list of Point3d, Vecs: list of Vector3d, Seeds: list of Point3d, Step: Int32, MaxSteps: Int32, SnapDist: Int32, Boundary: Curve; same code as python_3_script_2
list_length_2 = ListLength(List=scale_4.Geometry)  # disabled
delaunay_edges = DelaunayEdges(Points=merge, Plane=PlaneXY(0, 0, 0))  # -> Connectivity, Edges
scale_5 = Scale(Geometry=curve_4, Center=area_6.Centroid, Factor=number_slider_9)  # -> Geometry, Transform; disabled
multiplication_3 = Multiplication(A=list_length_2, B=number_slider_10)  # disabled
random_reduce = RandomReduce(List=scale_4.Geometry, Reduction=multiplication_3, Seed=1)  # -> simplify(List); disabled
surface_3 = Surface(scale_5.Geometry)  # disabled
curve_5 = Curve(python_3_script_2.roads)
curve_6 = Curve(python_3_script_3.roads)
panel = Panel(scale_5.Geometry)  # disabled
curve_7 = Curve([curve_6, curve_5])
merge_2 = Merge(Data1=surface_3, Data2=random_reduce)  # -> flatten(Result); disabled
number_slider_11 = Slider(8, range=0..100)  # disabled
area_7 = Area(Geometry=merge_2)  # -> Area, Centroid; disabled
number_slider_12 = Slider(4, range=0..10)  # disabled
point = Point(list_item)  # disabled
trim_with_region = TrimWithRegion(Curve=curve_7, Region=curve)  # -> Inside, Outside
distance = Distance(PointA=area_7.Centroid, PointB=point)  # disabled
curve_8 = Curve(flatten(trim_with_region.Inside))
bounds = Bounds(Numbers=distance)  # disabled
construct_domain_2 = ConstructDomain(DomainStart=number_slider_11, DomainEnd=number_slider_12)  # disabled
surface_split_2 = SurfaceSplit(Surface=surface_2, Curves=curve_8)
number_slider_13 = Slider(0.2, range=0..1)  # disabled
remap_numbers = RemapNumbers(Value=distance, Source=bounds, Target=construct_domain_2)  # -> Mapped, Clipped; disabled
curve_9 = Curve(surface_split_2)
construct_domain_3 = ConstructDomain(DomainStart=1, DomainEnd=3)  # disabled
negative_3 = Negative(Value=Slider(10, range=0..10))
negative_4 = Negative(Value=Slider(20, range=0..100))
number_slider_14 = Slider(4, range=0..10)  # disabled
jitter = Jitter(List=remap_numbers.Mapped, Jitter=number_slider_13, Seed=2)  # -> Values, Indices; disabled
offset_curve_3 = OffsetCurve(Curve=curve_9, Distance=negative_3, Corners=1)
list_length_3 = ListLength(List=jitter.Values)  # disabled
offset_curve_4 = OffsetCurve(Curve=curve_9, Distance=negative_4, Corners=1)
random_2 = Random(Range=construct_domain_3, Number=list_length_3, Seed=2, Integers=True)  # disabled
boundary_surfaces_3 = BoundarySurfaces(Edges=offset_curve_3)
addition = Addition(A=jitter.Values, B=random_2)  # disabled
multiplication_4 = Multiplication(A=number_slider_14, B=addition)  # disabled
boundary_surfaces_4 = BoundarySurfaces(Edges=offset_curve_4)
unit_z = UnitZ(Factor=multiplication_4)  # disabled
area_8 = Area(Geometry=boundary_surfaces_3)  # -> Area, Centroid
square_3 = Square(Value=Slider(10, range=0..100))
extrude = Extrude(Base=merge_2, Direction=unit_z)  # disabled
integer_division_6 = IntegerDivision(A=area_8.Area, B=square_3)
populate_geometry = PopulateGeometry(Geometry=boundary_surfaces_4, Count=integer_division_6, Seed=1)
panel_2 = Panel(integer_division_6)
pull_point_3 = PullPoint(Point=populate_geometry, Geometry=offset_curve_4, ClosestOnly=False)  # -> ClosestPoint, Distance
path_mapper = PathMapper(pull_point_3.Distance, source="{A;B;C;D;E}", target="{A;B;C}")
construct_domain_4 = ConstructDomain(DomainStart=Slider(0, range=0..100), DomainEnd=Slider(0.8, range=0..1))
bounds_2 = Bounds(Numbers=path_mapper)
remap_numbers_2 = RemapNumbers(Value=path_mapper, Source=bounds_2, Target=construct_domain_4)  # -> Mapped, Clipped
python_3_script_4 = Python3Script(ProbTree=remap_numbers_2.Mapped, Seed=Slider(37, range=0..100))  # -> out, OutputBools; inputs ProbTree: tree of Double
# ---------- python_3_script_4: Python ----------
import random
import Grasshopper as gh
from Grasshopper import DataTree
from Grasshopper.Kernel.Data import GH_Path

# 1. 初始化随机种子，保证结果可重复
# 建议在 GH 外部接一个 Integer 滑块到 Seed 端口
if Seed is not None:
    random.seed(Seed)

# 2. 创建一个新的 DataTree 用于存储布尔值，并指定类型为 bool
# 这能确保输出后的数据结构与输入完全一致
output_tree = DataTree[bool]()

# 3. 遍历输入树的每一个分支
for i in range(ProbTree.BranchCount):
    # 获取当前分支的路径 (例如 {0;0})
    path = ProbTree.Path(i)
    # 获取当前分支的所有数据
    branch_items = ProbTree.Branch(i)
    
    # 遍历分支内的每一个概率值
    for p in branch_items:
        # --- 核心概率匹配逻辑 ---
        # random.random() 生成 0.0 到 1.0 之间的浮点数
        is_true = random.random() < p
        
        # 保持路径一致，将结果添加到新树中
        output_tree.Add(is_true, path)

# 4. 输出最终的树
OutputBools = output_tree
# ---------- end python_3_script_4 ----------
panel_3 = Panel(remap_numbers_2.Mapped)
number_slider_15 = Slider(1.2, range=0..10)
cull_pattern = CullPattern(List=populate_geometry, CullPattern=python_3_script_4.OutputBools)
panel_4 = Panel(python_3_script_4.OutputBools)
curve_10 = Curve(boundary_surfaces_3)
multiplication_5 = Multiplication(A=Slider(4, range=0..10), B=number_slider_15)
multiplication_6 = Multiplication(A=Slider(12, range=0..100), B=number_slider_15)
explode = Explode(Curve=curve_10, Recursive=True)  # -> flatten(Segments), Vertices
multiplication_7 = Multiplication(A=Slider(8, range=0..10), B=number_slider_15)
multiplication_8 = Multiplication(A=Slider(3, range=0..10), B=number_slider_15)
point_2 = Point(cull_pattern)
construct_domain_5 = ConstructDomain(DomainStart=multiplication_5, DomainEnd=multiplication_6)
construct_domain_6 = ConstructDomain(DomainStart=multiplication_8, DomainEnd=multiplication_7)
curve_middle = CurveMiddle(Curve=explode.Segments)
multiplication_9 = Multiplication()
list_length_4 = ListLength(List=point_2)
closest_point = ClosestPoint(Point=point_2, Cloud=curve_middle)  # -> ClosestPoint, CPIndex, Distance
list_length_5 = ListLength(List=point_2)
random_3 = Random(Range=construct_domain_6, Number=list_length_4, Seed=2)
random_4 = Random(Range=construct_domain_5, Number=list_length_5, Seed=2)
list_item_2 = ListItem(List=explode.Segments, Index=closest_point.CPIndex, Wrap=True)
unit_vector = UnitVector(Vector=list_item_2)
negative_5 = Negative(Value=random_3)
negative_6 = Negative(Value=random_4)
deconstruct_vector = DeconstructVector(Vector=unit_vector)  # -> XComponent, YComponent, ZComponent
construct_domain_7 = ConstructDomain(DomainStart=negative_5, DomainEnd=random_3)
construct_domain_8 = ConstructDomain(DomainStart=negative_6, DomainEnd=random_4)
negative_7 = Negative(Value=deconstruct_vector.YComponent)
rectangle = Rectangle(Plane=point_2, XSize=construct_domain_7, YSize=construct_domain_8, Radius=0)  # -> Rectangle, Length
unit_y = UnitY(Factor=1)
vector_xyz = VectorXYZ(XComponent=deconstruct_vector.XComponent, YComponent=negative_7, ZComponent=deconstruct_vector.ZComponent)  # -> Vector, Length
area_9 = Area(Geometry=rectangle.Rectangle)  # -> Area, Centroid
angle = Angle(VectorA=vector_xyz.Vector, VectorB=unit_y)  # -> Angle, Reflex
unit_z_2 = UnitZ(Factor=1)
negative_8 = Negative(Value=angle.Angle)
rotate_3d = Rotate3D(Geometry=rectangle.Rectangle, Angle=negative_8, Center=area_9.Centroid, Axis=unit_z_2)  # -> Geometry, Transform
python_3_script_5 = Python3Script(InTree=rotate_3d.Geometry)  # -> out, flatten(OutTree); inputs InTree: tree of Curve
# ---------- python_3_script_5: Python ----------
import Rhino.Geometry as rg
from Grasshopper import DataTree
from Grasshopper.Kernel.Data import GH_Path

# 1. 初始化输出 DataTree，指定存储类型为 rg.Curve
out_tree = DataTree[rg.Curve]()

# 2. 遍历输入树的所有分支
for i in range(InTree.BranchCount):
    path = InTree.Path(i)
    branch_curves = InTree.Branch(i)
    
    # 用于存储当前分支内“已录入”的矩形，进行实时对比
    accepted_in_branch = []
    
    # 3. 按 list 顺序遍历当前分支内的每一个矩形 (rec)
    for j in range(len(branch_curves)):
        current_rec = branch_curves[j]
        
        if current_rec is None: continue
        
        is_overlapping = False
        
        # 4. 将当前矩形与已经录入列表的矩形逐一进行碰撞检查
        for accepted in accepted_in_branch:
            # 使用 PlanarCurveCollision 检查平面内两条曲线是否重叠
            # 参数：曲线A, 曲线B, 平面, 公差
            collision = rg.Curve.PlanarCurveCollision(current_rec, accepted, rg.Plane.WorldXY, 0.001)
            
            if collision:
                is_overlapping = True
                break # 一旦发现重叠，立即停止检查 accepted 列表，准备看下一个 rec
        
        # 5. 如果检查完一圈发现没有跟任何已录入的矩形冲突
        if not is_overlapping:
            accepted_in_branch.append(current_rec) # 录入对比列表
            out_tree.Add(current_rec, path)        # 录入输出 DataTree

# 最终输出
OutTree = out_tree
# ---------- end python_3_script_5 ----------
panel_5 = Panel(rotate_3d.Geometry)
multiplication_10 = Multiplication(A=Slider(8, range=0..10), B=number_slider_15)
multiplication_11 = Multiplication(A=Slider(3, range=0..10), B=number_slider_15)
surface_4 = Surface(python_3_script_5.OutTree)
list_length_6 = ListLength(List=surface_4)
construct_domain_9 = ConstructDomain(DomainStart=multiplication_11, DomainEnd=multiplication_10)
random_5 = Random(Range=construct_domain_9, Number=list_length_6, Seed=2)
multiplication_12 = Multiplication(A=random_5, B=Slider(4, range=0..10))
unit_z_3 = UnitZ(Factor=multiplication_12)
extrude_2 = Extrude(Base=surface_4, Direction=unit_z_3)
